# Grasshopper definition desk_try.ghx (Grasshopper 1.0.8)
# plug-ins: Human, opennest_2 Info, LunchBox

# 思路：
# 先做框架，再做腿，再做面板。
panel = Panel("""设计要求：
尺寸变化区间：高不变730。
长：500-2200，宽500-1000.800以内用小板，以上用大板1.5米宽。
标准尺寸：1800x800 要求和腿部比例最好看
结构强度要求中等-餐桌标准、会议桌、偶尔工作用桌子。
（工作桌：稳定性高，用于长期办公  操作桌：稳定性极高 用于厨房、台面加工、制作产品、站人。以后再开发）

目前任务：
选择1-2款最合理的椅子腿，确定一个基本结构方向，打样试验结构强度。
思路1：按照2200最大尺寸测试强度和腿部结构，做到最细腿。
2：桌面可选 0.8/1.3+铝蜂窝350一张/pvc或加厚铁板增加横档，反正以平整度和性价比为第一。
3：腿部可考虑型材。
4：不同类型的桌子 写不同的程序，不要混一起。
直脚桌、斜脚桌、独脚桌、框架桌、办公桌、操作桌、创意桌、几桌、餐厅桌。

-------
桌面定制服务：1电磁炉2线孔及海绵塞3拖线板槽4表面贴膜5简易麻将牌类游戏软垫6西餐套件7工作套件8磁浮摆件9其他各种应用扩展。""")

# ---- group: RH_IN:length
_1_桌面_length = Slider(1014, range=600..2200)

# ---- group: RH_IN:width
_2_桌面_wide = Slider(1300, range=600..1400)

# ----
pt = Point(<point referenced from the Rhino model>)
division = Division(A=_1_桌面_length, B=2)
division_2 = Division(A=_2_桌面_wide, B=2)
neg = Negative(Value=division)
neg_2 = Negative(Value=division_2)
tag = TextTag3D(Location=pt, Text=panel, Size=Slider(148, range=50..200), Colour=ColourSwatch(SwatchColor=RGB(0, 0, 0)), Justification=7)
dom = ConstructDomain(DomainStart=division_2, DomainEnd=neg_2)
dom_2 = ConstructDomain(DomainStart=division, DomainEnd=neg)

# ---- group: RH_IN:frame_inset
frame = Slider(200, range=0..200)

# ----
rectangle = Rectangle(Plane=PlaneXY(0, 0, 0), XSize=dom_2, YSize=dom, Radius=0)  # -> Rectangle, Length
neg_3 = Negative(Value=frame)

# ---- group: RH_IN:frame_thickness
_10_桌架结构厚度 = Slider(82.327, range=10..100)

# ----
offset = OffsetCurve(Curve=rectangle.Rectangle, Distance=neg_3, Plane=PlaneXY(0, 0, 0), Corners=1)
_45 = Integer(45)

# ---- group: RH_IN:round
_12_桌面圆角 = Slider(10, range=10..500)

# ----
cp = ControlPoints(Curve=offset)  # -> Points, Weights, Knots
addition = Addition(A=_45, B=90)
neg_4 = Negative(Value=_45)
neg_5 = Negative(Value=addition)
_270 = Integer(270)
_90 = Integer(90)
shift = ShiftList(List=cp.Points, Shift=1, Wrap=False)
neg_6 = Negative(Value=_10_桌架结构厚度)
merge = Merge(Data1=addition, Data2=neg_5, Data3=neg_4, Data4=_45)
neg_7 = Negative(Value=_10_桌架结构厚度)

# ---- group: RH_IN:leg_width
_3_腿宽度mm = Slider(67, range=10..200)

# ----
pt_2 = ConstructPoint(XCoordinate=0, YCoordinate=0, ZCoordinate=neg_6)
pt_3 = ConstructPoint(XCoordinate=0, YCoordinate=0, ZCoordinate=neg_7)
X = UnitX(Factor=shift)
Z = UnitZ(Factor=1)

# ---- group: RH_IN:frame_edge_thickness
_11_桌架边厚 = Slider(25, range=2..25)

# ----
rad = Radians(Degrees=merge)
addition_2 = Addition(A=_270, B=180)
neg_8 = Negative(Value=_270)
neg_9 = Negative(Value=addition_2)
addition_3 = Addition(A=_90, B=180)
neg_10 = Negative(Value=_90)
neg_11 = Negative(Value=addition_3)
crv = Curve(rectangle.Rectangle)
xy = XYPlane(Origin=pt_2)
xy_2 = XYPlane(Origin=pt_3)
vrot = Rotate(Vector=X, Axis=Z, Angle=rad)
merge_2 = Merge(Data1=addition_2, Data2=neg_9, Data3=neg_8, Data4=_270)
merge_3 = Merge(Data1=addition_3, Data2=neg_11, Data3=neg_10, Data4=_90)
division_3 = Division(A=_3_腿宽度mm, B=2)
fillet = Fillet(Curve=crv, Radius=_12_桌面圆角)

# ---- group: RH_IN:leg_open
_4_2_腿开距离mm = Slider(59, range=0..220)

# ----
remap = RemapNumbers(Value=_12_桌面圆角, Source=Domain(10, 500), Target=Domain(1, 1.35))  # -> Mapped, Clipped
rad_2 = Radians(Degrees=merge_2)
line = LineSDL(Start=shift, Direction=vrot, Length=division_3)  # -> flatten(Line)
rad_3 = Radians(Degrees=merge_3)

# ---- group: RH_IN:leg_height
_4_腿高度mm = Slider(703, range=500..750)

# ----
neg_12 = Negative(Value=_11_桌架边厚)
scale = Scale(Geometry=fillet, Center=Point(0, 0, 0), Factor=remap.Mapped)  # -> Geometry, Transform
Z_2 = UnitZ(Factor=_11_桌架边厚)
boundary = BoundarySurfaces(Edges=scale.Geometry)
neg_13 = Negative(Value=_4_腿高度mm)
_5_腿脚最小宽度 = Slider(4, range=4..10)
neg_14 = Negative(Value=_4_2_腿开距离mm)

# ---- group: RH_IN:leg_tiptoe_degree
_6_脚尖度 = Slider(1, range=0..1)

# ----
extr = Extrude(Base=boundary, Direction=Z_2)
end = EndPoints(Curve=line)  # -> Start, End
Z_3 = UnitZ(Factor=neg_13)
pt_4 = Point(end.End)
rotate = Rotate(Geometry=line, Angle=rad_3, Plane=pt_4)  # -> Geometry, Transform
rotate_2 = Rotate(Geometry=line, Angle=rad_2, Plane=pt_4)  # -> Geometry, Transform
end_2 = EndPoints(Curve=rotate_2.Geometry)  # -> Start, End
end_3 = EndPoints(Curve=rotate.Geometry)  # -> Start, End
pt_5 = Point(end_2.Start)
pt_6 = Point(end_3.Start)
pt_7 = Point([pt_6, pt_5])
line_2 = LineSDL(Start=shift, Direction=vrot, Length=neg_14)  # -> flatten(Line)
ln = Line(StartPoint=pt_6, EndPoint=pt_5)
move = Move(Geometry=ln, Motion=Z_3)  # -> Geometry, Transform
move_2 = Move(Geometry=move.Geometry, Motion=line_2)  # -> Geometry, Transform
crv_2 = Curve(move_2.Geometry)
len = Length(Curve=crv_2)
subtraction = Subtraction(A=len, B=_5_腿脚最小宽度)
division_4 = Division(A=subtraction, B=2)
dom_3 = ConstructDomain(DomainStart=0, DomainEnd=division_4)
line_3 = Line(ln)
remap_2 = RemapNumbers(Value=_6_脚尖度, Source=Domain(0, 1), Target=dom_3)  # -> Mapped, Clipped
neg_15 = Negative(Value=remap_2.Mapped)
ext = ExtendCurve(Curve=crv_2, Type=0, Start=neg_15, End=neg_15)  # -> graft(Curve)
line_4 = Line(graft(line_3))
end_4 = EndPoints(Curve=ext)  # -> Start, End
end_5 = EndPoints(Curve=line_4)  # -> Start, End
ln_2 = Line(StartPoint=end_5.End, EndPoint=end_4.End)
line_5 = Line(flatten(ln_2))
ln_3 = Line(StartPoint=end_5.Start, EndPoint=end_4.Start)
line_6 = Line(flatten(ln_3))
merge_4 = Merge(Data1=line_6, Data2=line_5)
pcx = CurvePlane(Curve=merge_4, Plane=xy_2)  # -> flatten(Points), ParamsC, ParamsP
pt_8 = Point(flatten(pcx.Points))

# ---- group: RH_IN:lower_leg_depth
_8_腿_下深 = Slider(0.742, range=0..1)

# ----
loft = Loft(Curves=[ln_3, ln_2], Options={Adjust=False, Closed=False, LoftEnds=0, LoftSimp=0, LoftType=0, Rebuild=10, Refit=0.01})
_8 = Slider(0.542, range=0..1)

# ---- group: RH_IN:upper_leg_depth
_7_腿_上深 = Slider(62.556, range=4..200)

# ----
pt_9 = Point(end_5.End)
pt_10 = Point(end_5.Start)
dom_4 = ConstructDomain(DomainStart=4, DomainEnd=_7_腿_上深)
merge_5 = Merge(Data1=end_4.Start, Data2=end_4.End)
remap_3 = RemapNumbers(Value=_8_腿_下深, Source=Domain(0, 1), Target=dom_4)  # -> Mapped, Clipped
range = Range(Domain=Domain(0, 1), Steps=10)
merge_6 = Merge(Data1=pt_10, Data2=pt_9)
line_7 = LineSDL(Start=merge_6, Direction=graft(vrot), Length=_7_腿_上深)
line_8 = LineSDL(Start=merge_5, Direction=graft(vrot), Length=remap_3.Mapped)
panel_2 = Panel(remap_3.Mapped)
end_6 = EndPoints(Curve=line_8)  # -> Start, End
rulesrf = RuledSurface(CurveA=line_7, CurveB=line_8)
end_7 = EndPoints(Curve=line_7)  # -> Start, End
pt_11 = Point(end_6.End)
pt_12 = Point(pt_11)
pt_13 = Point(end_7.End)
pt_14 = Point(pt_13)
ln_4 = Line(StartPoint=pt_14, EndPoint=pt_12)  # -> flatten(Line)
item = ListItem(List=ln_4, Index=[5, 7], Wrap=True)
item_2 = ListItem(List=ln_4, Index=[2, 4], Wrap=True)
item_3 = ListItem(List=ln_4, Index=[1, 3], Wrap=True)
item_4 = ListItem(List=ln_4, Index=[0, 6], Wrap=True)
flip = FlipMatrix(Data=pt_11)
flip_2 = FlipMatrix(Data=pt_13)
bang = ExplodeTree(Data=flip)  # -> _00000, _00001
bang_2 = ExplodeTree(Data=flip_2)  # -> _00000, _00001

# ---- group: RH_IN:leg_belly_depth
_9_腿_肚子深 = Slider(106.106, range=0..190)

# ----
ln_5 = Line(StartPoint=bang._00000, EndPoint=bang._00001)
ln_6 = Line(StartPoint=bang_2._00000, EndPoint=bang_2._00001)
pt_15 = Point(pt_13)
midpt = CurveMiddle(Curve=ln_5)  # -> flatten(Midpoint)
len_2 = Length(Curve=ln_5)
midpt_2 = CurveMiddle(Curve=ln_6)  # -> flatten(Midpoint)
line_9 = LineSDL(Start=midpt_2, Direction=vrot, Length=_9_腿_肚子深)
division_5 = Division(A=len_2, B=2)
end_8 = EndPoints(Curve=line_9)  # -> Start, End
item_5 = ListItem(List=pt_15, Index=0, Wrap=True)  # -> flatten(Item)
pt_16 = Point(pt_11)
pt_17 = Point(end_8.Start)
pt_18 = Point(pt_13)
pt_19 = Point(end_8.End)
pt_20 = Point(pt_19)
pline = PolyLine(Vertices=pt_20, Closed=True)  # -> flatten(Polyline)
flip_3 = FlipCurve(Curve=pline)  # -> Curve, Flag
pt_21 = Point(graft(pt_19))
vec2pt = Vector2Pt(PointA=item_5, PointB=pt_19, Unitize=False)  # -> Vector, Length
vec2pt_2 = Vector2Pt(PointA=item_5, PointB=pt_17, Unitize=False)  # -> Vector, Length
ln_7 = Line(StartPoint=pt_21, EndPoint=pt_18)  # -> simplify(Line)
angle = Angle(VectorA=vec2pt_2.Vector, VectorB=vec2pt.Vector)  # -> Angle, Reflex
join = JoinCurves(Curves=ln_7, Preserve=False)
tan = Tangent(Value=angle.Angle)
multiplication = Multiplication(A=tan, B=division_5)
line_10 = LineSDL(Start=midpt, Direction=vrot, Length=multiplication)
end_9 = EndPoints(Curve=line_10)  # -> Start, End
pt_22 = Point(end_9.End)
ln_8 = Line(StartPoint=pt_19, EndPoint=pt_22)
crv_3 = Curve(ln_8)
pcx_2 = CurvePlane(Curve=crv_3, Plane=xy)  # -> Points, ParamsC, ParamsP
pt_23 = Point(flatten(pcx_2.Points))
merge_7 = Merge(Data1=pt_7, Data2=pt_8, Data3=pt_23)
points = PointList(Points=merge_7, Size=Slider(12.262, range=0..100))
item_6 = ListItem(List=merge_7, Index=[19, 15, 14, 18], Wrap=True)
item_7 = ListItem(List=merge_7, Index=[18, 10, 9, 17], Wrap=True)
item_8 = ListItem(List=merge_7, Index=[17, 13, 12, 16], Wrap=True)
item_9 = ListItem(List=merge_7, Index=[16, 8, 11, 19], Wrap=True)
item_10 = ListItem(List=merge_7, Index=[16, 19, 18, 17], Wrap=True)
item_11 = ListItem(List=merge_7, Index=[3, 11, 8, 0], Wrap=True)
item_12 = ListItem(List=merge_7, Index=[6, 14, 15, 7], Wrap=True)
item_13 = ListItem(List=merge_7, Index=[1, 5, 4, 0, 3, 7, 6, 2], Wrap=True)
item_14 = ListItem(List=merge_7, Index=[4, 12, 13, 5], Wrap=True)
item_15 = ListItem(List=merge_7, Index=[1, 9, 10, 2], Wrap=True)
plfit = PlaneFit(Points=item_9)  # -> Plane, Deviation
pline_2 = PolyLine(Vertices=item_14, Closed=True)
pline_3 = PolyLine(Vertices=item_10, Closed=True)
pline_4 = PolyLine(Vertices=item_11, Closed=True)
pline_5 = PolyLine(Vertices=item_12, Closed=True)
pline_6 = PolyLine(Vertices=item_15, Closed=True)
plfit_2 = PlaneFit(Points=item_7)  # -> Plane, Deviation
plfit_3 = PlaneFit(Points=item_8)  # -> Plane, Deviation
plfit_4 = PlaneFit(Points=item_6)  # -> Plane, Deviation
pline_7 = PolyLine(Vertices=item_13, Closed=True)
pcx_3 = CurvePlane(Curve=item, Plane=plfit_4.Plane)  # -> flatten(Points), ParamsC, ParamsP
pcx_4 = CurvePlane(Curve=item_2, Plane=plfit_2.Plane)  # -> flatten(Points), ParamsC, ParamsP
pcx_5 = CurvePlane(Curve=item_3, Plane=plfit_3.Plane)  # -> flatten(Points), ParamsC, ParamsP
pcx_6 = CurvePlane(Curve=item_4, Plane=plfit.Plane)  # -> flatten(Points), ParamsC, ParamsP
boundary_2 = BoundarySurfaces(Edges=[pline_2, pline_4, pline_5, pline_6])
loft_2 = Loft(
    Curves=[flip_3.Curve, pline_3],
    Options={Adjust=False, Closed=False, LoftEnds=0, LoftSimp=0, LoftType=0, Rebuild=10, Refit=0.01})
ins = InsertItems(List=item_6, Item=pcx_3.Points, Indices=[3, 1], Wrap=True)
ins_2 = InsertItems(List=item_9, Item=pcx_6.Points, Indices=[1, 3], Wrap=True)
ins_3 = InsertItems(List=item_7, Item=pcx_4.Points, Indices=[3, 1], Wrap=True)
ins_4 = InsertItems(List=item_8, Item=pcx_5.Points, Indices=[3, 1], Wrap=True)
pline_8 = PolyLine(Vertices=ins_2, Closed=True)
pline_9 = PolyLine(Vertices=ins, Closed=True)
pline_10 = PolyLine(Vertices=ins_3, Closed=True)
pline_11 = PolyLine(Vertices=ins_4, Closed=True)
boundary_3 = BoundarySurfaces(Edges=pline_8)
boundary_4 = BoundarySurfaces(Edges=pline_9)
boundary_5 = BoundarySurfaces(Edges=pline_10)
boundary_6 = BoundarySurfaces(Edges=pline_11)
merge_8 = Merge(Data1=boundary_3, Data2=boundary_4, Data3=boundary_5, Data4=boundary_6, Data5=loft_2, Data6=boundary_2)
mesh_brep = MeshBrep(
    Brep=merge_8,
    Settings={GridMaxCount=0, GridMinCount=16, JaggedSeams=False, MaxEdgeLength=0, MinEdgeLength=0.0001, MinTolerance=0, Refine=True, RefineAngle=0, RelativeTolerance=0.65, SimplePlanes=True, Tolerance=0})
ln_9 = Line(StartPoint=graft(pt_22), EndPoint=pt_16)  # -> simplify(Line)
join_2 = JoinCurves(Curves=ln_9, Preserve=False)
merge_9 = Merge(Data1=join, Data2=join_2)
loft_3 = Loft(Curves=merge_9, Options={Adjust=False, Closed=False, LoftEnds=0, LoftSimp=0, LoftType=0, Rebuild=10, Refit=0.01})
merge_10 = Merge(Data1=loft, Data2=rulesrf, Data3=loft_3)
mesh_brep_2 = MeshBrep(
    Brep=merge_10,
    Settings={GridMaxCount=0, GridMinCount=16, JaggedSeams=False, MaxEdgeLength=0, MinEdgeLength=0.0001, MinTolerance=0, Refine=True, RefineAngle=0, RelativeTolerance=0.65, SimplePlanes=True, Tolerance=0})
disjoint_mesh = DisjointMesh(Mesh=mesh_brep_2)
flatten_tree = FlattenTree(Tree=disjoint_mesh, Path="{0}")
number = Number([1, 2, 0, 9])
unit_y = UnitY(Factor=1)
unit_x = UnitX(Factor=1)
panel_3 = Panel(flatten_tree)
unit_z = UnitZ(Factor=1)
list_item = ListItem(List=flatten_tree, Index=number, Wrap=True)
subtraction_2 = Subtraction(A=unit_x, B=unit_y)
construct_plane = ConstructPlane(Origin=Point(0, 0, 0), XAxis=subtraction_2, YAxis=unit_z)
mesh_join = MeshJoin()
mesh_join_2 = MeshJoin(Meshes=list_item)
weld_mesh = WeldMesh(Mesh=mesh_join_2, Angle=3.141592654)
weld_mesh_2 = WeldMesh(Mesh=mesh_join, Angle=3.141592654)
merge_11 = Merge(Data1=merge_10, Data2=merge_8, Data3=extr)  # -> flatten(Result)
createatts = CreateAttributes(enableFullPath=False)
mesh = Mesh(weld_mesh)
bounding_box = BoundingBox(Content=mesh, Plane=construct_plane)  # -> Box, Box_2
item_selector = ItemSelector(weld_mesh_2)
project = Project(Geometry=mesh, Plane=construct_plane)  # -> Geometry, Transform
project_2 = Project(Geometry=mesh, Plane=construct_plane)  # -> Geometry, Transform
project_3 = Project(Geometry=mesh, Plane=construct_plane)  # -> Geometry, Transform
project_4 = Project(Geometry=mesh, Plane=construct_plane)  # -> Geometry, Transform
mesh_brep_3 = MeshBrep(
    Brep=merge_11,
    Settings={GridMaxCount=0, GridMinCount=16, JaggedSeams=False, MaxEdgeLength=0, MinEdgeLength=0.0001, MinTolerance=0, Refine=True, RefineAngle=0, RelativeTolerance=0.65, SimplePlanes=True, Tolerance=0})
deconstruct_box = DeconstructBox(Box=bounding_box.Box)  # -> Plane, X, Y, Z
bake = ObjectBake(BakeToggle=False, Layer="GH_Bake", ObjectName="GH_Obj", ObjectColor=RGB(255, 255, 255), LayerColor=RGB(255, 255, 255))
panel_4 = Panel(merge_11)
brep_join = BrepJoin(Breps=merge_11)  # -> Breps, Closed
mesh_edges = MeshEdges(Mesh=project_3.Geometry)  # -> NakedEdges, InteriorEdges, NonManifoldEdges
mesh_edges_2 = MeshEdges(Mesh=project_4.Geometry)  # -> NakedEdges, InteriorEdges, NonManifoldEdges
mesh_edges_3 = MeshEdges(Mesh=project.Geometry)  # -> NakedEdges, InteriorEdges, NonManifoldEdges
mesh_edges_4 = MeshEdges(Mesh=project_2.Geometry)  # -> NakedEdges, InteriorEdges, NonManifoldEdges

# ---- group: RH_OUT:desk
mesh_2 = Mesh(mesh_brep_3)

# ----
mesh_3 = Mesh(item_selector)
rectangle_2 = Rectangle(Plane=PlaneXY(0, 0, 0), XSize=deconstruct_box.X, YSize=deconstruct_box.Y, Radius=0)  # -> Rectangle, Length
rectangle_3 = Rectangle(Plane=PlaneXY(0, 0, 0), XSize=deconstruct_box.X, YSize=deconstruct_box.Y, Radius=0)  # -> Rectangle, Length
rectangle_4 = Rectangle(Plane=PlaneXY(0, 0, 0), XSize=deconstruct_box.X, YSize=deconstruct_box.Y, Radius=0)  # -> Rectangle, Length
rectangle_5 = Rectangle(Plane=PlaneXY(0, 0, 0), XSize=deconstruct_box.X, YSize=deconstruct_box.Y, Radius=0)  # -> Rectangle, Length
mesh_join_3 = MeshJoin(Meshes=mesh_2)
panel_5 = Panel(mesh_brep_3)
area = Area(Geometry=brep_join.Breps)  # -> Area, Centroid
volume = Volume(Geometry=brep_join.Breps)  # -> Volume, Centroid
join_curves = JoinCurves(Curves=mesh_edges.InteriorEdges, Preserve=False)
join_curves_2 = JoinCurves(Curves=mesh_edges_3.InteriorEdges, Preserve=False)
join_curves_3 = JoinCurves(Curves=mesh_edges_2.InteriorEdges, Preserve=False)
join_curves_4 = JoinCurves(Curves=mesh_edges_4.InteriorEdges, Preserve=False)
bounding_box_2 = BoundingBox(Content=mesh_join_3, Plane=PlaneXY(0, 0, 0))  # -> Box, Box_2
panel_6 = Panel(volume.Volume)
merge_12 = Merge(Data1=rectangle_5.Rectangle, Data2=rectangle_2.Rectangle, Data3=rectangle_3.Rectangle, Data4=rectangle_4.Rectangle)
absolute = Absolute(Value=area.Area)
curve_to_polyline = CurveToPolyline(Curve=join_curves_3, ToleranceDistance=0, ToleranceAngle=0)  # -> Polyline, Segments
curve_to_polyline_2 = CurveToPolyline(Curve=join_curves, ToleranceDistance=0, ToleranceAngle=0)  # -> Polyline, Segments
absolute_2 = Absolute(Value=volume.Volume)
curve_to_polyline_3 = CurveToPolyline(Curve=join_curves_2, ToleranceDistance=0, ToleranceAngle=0)  # -> Polyline, Segments
curve_to_polyline_4 = CurveToPolyline(Curve=join_curves_4, ToleranceDistance=0, ToleranceAngle=0)  # -> Polyline, Segments
box = Box(bounding_box_2.Box_2)
deconstruct_box_2 = DeconstructBox(Box=bounding_box_2.Box_2)  # -> Plane, X, Y, Z
flatten_tree_2 = FlattenTree(Tree=merge_12, Path="{0}")
volume_2 = Volume(Geometry=box)  # -> Volume, Centroid
mass_addition = MassAddition(Input=absolute)  # -> Result, PartialResults
mass_addition_2 = MassAddition(Input=absolute_2)  # -> Result, PartialResults
panel_7 = Panel(area.Area)
number_2 = Number(2440)
number_3 = Number(1220)
rectangle_6 = Rectangle(Plane=construct_plane, XSize=number_2, YSize=number_3, Radius=0)  # -> Rectangle, Length
merge_13 = Merge(
    Data1=curve_to_polyline_2.Polyline,
    Data2=curve_to_polyline.Polyline,
    Data3=curve_to_polyline_3.Polyline,
    Data4=curve_to_polyline_4.Polyline)
deconstruct_domain = DeconstructDomain(Domain=deconstruct_box_2.Z)  # -> Start, End
deconstruct_domain_2 = DeconstructDomain(Domain=deconstruct_box_2.Y)  # -> Start, End
deconstruct_domain_3 = DeconstructDomain(Domain=deconstruct_box_2.X)  # -> Start, End

# ---- group: RH_OUT:surface_area_total
number_4 = Number(mass_addition.Result)

# ---- group: RH_OUT:wood_volume
number_5 = Number(mass_addition_2.Result)

# ----
run = Run(True)
subtraction_3 = Subtraction(A=deconstruct_domain.End, B=deconstruct_domain.Start)
subtraction_4 = Subtraction(A=deconstruct_domain_2.End, B=deconstruct_domain_2.Start)
subtraction_5 = Subtraction(A=deconstruct_domain_3.End, B=deconstruct_domain_3.Start)
opennest1 = OpenNest1(
    Sheets=rectangle_6.Rectangle,
    Geo=curve_to_polyline_2.Polyline,
    Spacing=1,
    Placement=1,
    Tolerance=0.1,
    Rotations=4,
    Iterations=1,
    Seed=1,
    Reset=True,
    Run=run)  # -> Sheets, Geo, ID, Transform, IDS
absolute_3 = Absolute(Value=subtraction_3)
absolute_4 = Absolute(Value=subtraction_4)
absolute_5 = Absolute(Value=subtraction_5)
custom_preview = CustomPreview(
    Geometry=opennest1.Geo,
    Material={diffuse=RGB(221, 160, 221), emission=RGB(66, 48, 66), shine=0.5, specular=RGB(255, 255, 255), transparency=0})

# ---- group: RH_OUT:bounding_height
number_6 = Number(absolute_3)

# ---- group: RH_OUT:bounding_width
number_7 = Number(absolute_4)

# ---- group: RH_OUT:bounding_length
number_8 = Number(absolute_5)
