# Grasshopper definition test_box.gh (Grasshopper 1.0.8)

rh_in_length = Number(1.8)
rh_in_width = Number(0.65)
rh_in_height = Number(0.78)
box = CenterBox(Base=PlaneXY(0, 0, 0), X=rh_in_length, Y=rh_in_width, Z=rh_in_height)

# ---- group: RH_OUT:box
mesh = Mesh(box)
